# Grasshopper definition testfile.gh (Grasshopper 1.0.7)
# plug-ins: LunchBox

# PARAMETRIC
# HOUSE
# GHFILE.COM
point = Point([Point(-13.99687496, -37.90440247, 0), Point(-13.99687496, -37.90440247, 288.0500574)])
polyline = PolyLine(Vertices=point, Closed=False)
gene_pool = GenePool(Decimals=2, Maximum=100, Minimum=20, Value=[65.68628567, 39.19973728, 68.64869645])
gene_pool_2 = GenePool(Decimals=2, Maximum=100, Minimum=20, Value=[95.2, 23.03, 32.16])
perp_frames = PerpFrames(Curve=polyline, Count="2", Align=True)  # -> Frames, Parameters
gene_pool_3 = GenePool(Decimals=2, Maximum=90, Minimum=0, Value=[42.98, 36.28, 71.46])
number = Number(gene_pool)
number_2 = Number(gene_pool_2)
galapagos = Galapagos(fitness=number_3, gene=[gene_pool_3, gene_pool, gene_pool_2])
plane = Plane(perp_frames.Frames)
construct_domain = ConstructDomain(DomainStart=expr("-x/2", number), DomainEnd=expr("x/2", number))
construct_domain_2 = ConstructDomain(DomainStart=expr("-x/2", number_2), DomainEnd=expr("x/2", number_2))
rotate_plane = RotatePlane(Plane=plane, Angle=degrees(gene_pool_3))
rectangle = Rectangle(Plane=rotate_plane, XSize=construct_domain, YSize=construct_domain_2, Radius=0)  # -> Rectangle, Length
mass_addition = MassAddition(Input=[gene_pool_3, gene_pool, gene_pool_2])  # -> Result, PartialResults
discontinuity = Discontinuity(Curve=rectangle.Rectangle, Level=1)  # -> simplify(Points), Parameters
number_3 = Number(mass_addition.Result)
nurbs_curve = NurbsCurve(Vertices=discontinuity.Points, Degree=3, Periodic=False)  # -> flatten(Curve), Length, Domain
loft = Loft(
    Curves=nurbs_curve.Curve,
    Options={Adjust=False, Closed=False, LoftEnds=0, LoftSimp=0, LoftType=0, Rebuild=10, Refit=0.01})
point_2 = Point(Point(12.82262475, -2.990475854, 0))
brep_edges = BrepEdges(Brep=loft)  # -> Naked, Interior, NonManifold
quad_panels = QuadPanels(Surface=loft, UDivisions=Slider(12, range=3..12), VDivisions=Slider(8, range=3..12))
bounding_box = BoundingBox(Content=[loft, point_2], Plane=PlaneXY(0, 0, 0), UnionBox=True)  # -> Box, Box_2
panel_frame = PanelFrame(Panel=quad_panels, ScaleFactor=Slider(0.76, range=0..1))  # -> PanelFrame, Panel
curve = Curve(brep_edges.Naked)
deconstruct_brep = DeconstructBrep(Brep=bounding_box.Box)  # -> Faces, Edges, Vertices
list_item = ListItem(List=curve, Index=0, Wrap=True)  # -> Item, Item1, Item2
list_item_2 = ListItem(List=deconstruct_brep.Faces, Index=Slider(1, range=0..5), Wrap=True)
custom_preview = CustomPreview(Geometry=panel_frame.PanelFrame, Material=ColourSwatch(SwatchColor=RGB(255, 255, 255)))
list_item_3 = ListItem(List=deconstruct_brep.Faces, Index=Slider(2, range=0..5), Wrap=True)
custom_preview_2 = CustomPreview(Geometry=panel_frame.Panel, Material=ColourSwatch(SwatchColor=RGB(41, 226, 255)))
curve_2 = Curve(list_item.Item)
curve_3 = Curve(list_item.Item2)
brep_edges_2 = BrepEdges(Brep=panel_frame.PanelFrame)  # -> Naked, Interior, NonManifold
project = Project(Geometry=curve_2, Plane=list_item_2)  # -> Geometry, Transform
project_2 = Project(Geometry=curve_3, Plane=list_item_3)  # -> Geometry, Transform
loft_2 = Loft(
    Curves=[curve_2, project.Geometry],
    Options={Adjust=False, Closed=False, LoftEnds=0, LoftSimp=0, LoftType=0, Rebuild=10, Refit=0.01})
loft_3 = Loft(
    Curves=[curve_3, project_2.Geometry],
    Options={Adjust=False, Closed=False, LoftEnds=0, LoftSimp=0, LoftType=0, Rebuild=10, Refit=0.01})
curve_4 = Curve(project.Geometry)
curve_5 = Curve(project_2.Geometry)
yz_plane = YZPlane(Origin=point_2)
xz_plane = XZPlane(Origin=point_2)
project_3 = Project(Geometry=curve_5, Plane=yz_plane)  # -> Geometry, Transform
project_4 = Project(Geometry=curve_4, Plane=xz_plane)  # -> Geometry, Transform
loft_4 = Loft(
    Curves=[curve_4, project_4.Geometry],
    Options={Adjust=False, Closed=False, LoftEnds=0, LoftSimp=0, LoftType=0, Rebuild=10, Refit=0.01})
loft_5 = Loft(
    Curves=[curve_5, project_3.Geometry],
    Options={Adjust=False, Closed=False, LoftEnds=0, LoftSimp=0, LoftType=0, Rebuild=10, Refit=0.01})
brep_join = BrepJoin(Breps=flatten([loft, loft_2, loft_3, loft_4, loft_5]))  # -> Breps, Closed
number_4 = Number(polyline)
unit_z = UnitZ(Factor=1)
cap_holes = CapHoles(Brep=brep_join.Breps)
division = Division(A=number_4, B=Slider(15, range=3..20))
brep_edges_3 = BrepEdges(Brep=cap_holes)  # -> Naked, Interior, NonManifold
contour = Contour(Shape=cap_holes, Point=point_2, Direction=unit_z, Distance=expr("x-0.001", division))  # -> flatten(Contours)
custom_preview_3 = CustomPreview(
    Geometry=cap_holes,
    Material={diffuse=RGB(221, 160, 221), emission=RGB(66, 48, 66), shine=0.5, specular=RGB(255, 255, 255), transparency=0})
surface = Surface(contour)
list_item_4 = ListItem(List=surface, Index=0, Wrap=True)  # -> Item1, Item
custom_preview_4 = CustomPreview(Geometry=surface, Material=ColourSwatch(SwatchColor=RGB(255, 255, 0)))
custom_preview_5 = CustomPreview(
    Geometry=[loft_5, loft_4, loft_2, loft_3, list_item_4.Item1, list_item_4.Item],
    Material=ColourSwatch(SwatchColor=RGBA(0, 0, 0, 186)))
